# Grasshopper definition voronoi_massing_automation.gh (Grasshopper 1.0.8)

# 1.set bounding curve
curve = Curve(<curve referenced from the Rhino model>)
surface = Surface(curve)
python_3_script = Python3Script(x=Button())  # -> out, A
# ---------- python_3_script: Python ----------
import random 
random_number = random.randint(1, 20)

# 將結果輸出到 A 端口
A = random_number
# ---------- end python_3_script ----------
populate_2d = Populate2D(Region=surface, Count=Slider(40, range=0..100), Seed=python_3_script.A)
voronoi = Voronoi(Points=populate_2d, Radius=Slider(0.9, range=0.5..2), Boundary=surface, BruteForceOverride=False)
boundary_surfaces = BoundarySurfaces(Edges=voronoi)
area = Area(Geometry=boundary_surfaces)  # -> Area, Centroid
python_3_script_2 = Python3Script(FPin=area.Area)  # -> out, area_total; inputs FPin: list of Double
# ---------- python_3_script_2: Python ----------
area_total = 0.0
for a in FPin:
    if isinstance(a, (int, float)):
        area_total += a
# ---------- end python_3_script_2 ----------

number_slider = Slider(4, range=3..8)
number_slider_2 = Slider(3, range=0..20)
ironpython_2_script = IronPython2Script(
    site=python_3_script_2.area_total,
    FPin=boundary_surfaces,
    FARmax=number_slider,
    CovMin=Slider(0.6, range=0..1),
    CovMax=Slider(0.9, range=0..1),
    FloorH=Slider(0.8, range=0.3..1),
    MaxN=Slider(25, range=0..40),
    Seed=number_slider_2)  # -> out, Bldg, FP, flatten(UsedFAR), cov_target, UsedCov; inputs FPin: list of Brep
# ---------- ironpython_2_script: IronPython ----------
"""使用 Voronoi 面當 footprint，多棟隨機量體生成

Inputs:
    FPin: Voronoi 面 (Brep) 的 List，通常來自 Boundary Surfaces
    FARmax: 容積率上限，250 (250%) 或 2.5
    CovMin: 最小建蔽率 (0~1)
    CovMax: 最大建蔽率 (0~1)
    FloorH: 一層樓高度 (m)
    MaxN: 最多棟數
    Seed: 隨機種子 (int)

Outputs:
    Bldg: 建築量體 Breps (extruded Voronoi)
    FP: 被選中的 footprint Breps
    UsedFAR: 實際容積率 (小數，例如 2.3 = 230%)
    UsedCov: 實際建蔽率 (0~1)
"""

import Rhino.Geometry as rg
import random

# ---------- 預設值 ----------
if FARmax is None: FARmax = 250.0
if CovMin is None: CovMin = 0.5
if CovMax is None: CovMax = 0.9
if FloorH is None: FloorH = 3.6
if MaxN is None or MaxN < 1: MaxN = 10
if Seed is None: Seed = 1
cov_target = random.uniform(CovMin, CovMax)
cov_tol = 0.05 
random.seed(int(Seed))

# FARmax 轉成小數 (250 -> 2.5)
if FARmax > 10.0:
    far_limit = FARmax / 100.0
else:
    far_limit = FARmax

# ---------- 收集所有 Voronoi 面積 ----------
breps_all = []
areas_all = []

if FPin is None:
    FPin = []

for b in FPin:
    if b is None:
        continue
    amp = rg.AreaMassProperties.Compute(b)
    if not amp:
        continue
    a = amp.Area
    if a <= 0:
        continue
    breps_all.append(b)
    areas_all.append(a)

if not breps_all:
    Bldg = []
    FP = []
    UsedFAR = 0.0
    UsedCov = 0.0
else:
    # 假設所有 Voronoi 面大致拼成整個基地
    site_area = sum(areas_all)

    # ---------- 隨機選一些 Voronoi 面，控制建蔽率 ----------
    indices = range(len(breps_all))
    indices = list(indices)
    random.shuffle(indices)

    selected_idx = []
    selected_area = 0.0

    
    for idx in indices:
        if len(selected_idx) >= MaxN:
            break

        a = areas_all[idx]
        new_area = selected_area + a
        new_cov = new_area / site

        # 不可以超過 CovMax
        if new_cov > CovMax:
            continue

        # 加進來
        selected_idx.append(idx)
        selected_area = new_area

        # 如果 new_cov 與 cov_target 差距在 ±5% 內，可以停
        if abs(new_cov - cov_target) <= cov_tol:
            break

        # 如果 new_cov 已經超過 cov_target
        # 但還沒到 ±5%，那也可以停（避免一直往上衝）
        if new_cov > cov_target:
            break


    # 如果還是低於 CovMin，就硬補一些最小的面進來
    if selected_area / site < CovMin:
        # 找沒被選中的 index，照面積從小到大排
        print('das')
        remaining = [i for i in range(len(breps_all)) if i not in selected_idx]
        remaining_sorted = sorted(remaining, key=lambda i: areas_all[i])
        for idx in remaining_sorted:
            if len(selected_idx) >= MaxN:
                break
            a = areas_all[idx]
            selected_idx.append(idx)
            selected_area += a
            if selected_area / site >= CovMin:
                break

    if not selected_idx:
        Bldg = []
        FP = []
        UsedFAR = 0.0
        usedCov = 0.0
    else:
        footprints = [breps_all[i] for i in selected_idx]
        foot_areas = [areas_all[i] for i in selected_idx]

        used_cov = selected_area / site

        # ---------- 根據 FAR 限制配高度 ----------
        # 目標 FAR 在 90%~99% 上限之間
        far_target = far_limit * random.uniform(0.90, 0.99)
        # Σ(A_i * H_i) = far_target * site_area * FloorH
        target_volume = far_target * site * FloorH

        multipliers = [random.uniform(0.7, 1.3) for _ in footprints]

        temp_sum = 0.0
        for a, m in zip(foot_areas, multipliers):
            temp_sum += a * m

        if temp_sum <= 0:
            heights = [0.0 for _ in footprints]
            used_far = 0.0
        else:
            scale_factor = target_volume / temp_sum
            heights = [m * scale_factor for m in multipliers]

            actual_volume = 0.0
            for a, h in zip(foot_areas, heights):
                actual_volume += a * h

            # FAR (小數) = (Σ A_i * H_i / FloorH) / site_area
            used_far = (actual_volume / FloorH) / site
        # ---------- Extrusion：用 Extrusion.Create + ToBrep ----------
        buildings = []

for fp, h in zip(footprints, heights):
    # 從 Voronoi Brep 抓封閉邊界 curve
    edge_curves = list(fp.DuplicateEdgeCurves(True))
    if not edge_curves:
        continue

    joined = rg.Curve.JoinCurves(edge_curves)
    if not joined or len(joined) == 0:
        continue

    base_crv = joined[0]
    if not base_crv.IsClosed:
        # 沒有封閉就不要拿來 extrude
        continue

    # 用封閉曲線做 capped extrusion
    ext = rg.Extrusion.Create(base_crv, h, True)
    if not ext:
        continue

    brep_ex = ext.ToBrep()
    if brep_ex:
        buildings.append(brep_ex)

Bldg = buildings
FP = footprints
UsedFAR = used_far
UsedCov = used_cov
# ---------- end ironpython_2_script ----------
panel = Panel(ironpython_2_script.UsedFAR)
panel_2 = Panel(ironpython_2_script.UsedCov)
panel_3 = Panel(ironpython_2_script.cov_target)

# ----
# 3."True" : save data to csv
boolean_toggle = BooleanToggle(False)
file_path = FilePath("C:\Users\harry\Desktop\00Projectz\Computation_Studio\sculpture.csv")
python_3_script_3 = Python3Script(
    fp=file_path,
    seed=number_slider_2,
    farmax=number_slider,
    usedFAR=ironpython_2_script.UsedFAR,
    cov_target=ironpython_2_script.cov_target,
    usedCOV=ironpython_2_script.UsedCov,
    write=boolean_toggle)  # -> out, a; inputs fp: String, seed: Int32, farmax: Double, usedFAR: Double, cov_target: Double, usedCOV: Double
# ---------- python_3_script_3: Python ----------
import csv
import os
fp = str(fp)
fieldnames = ["Seed", "FARmax", "UsedFAR", "cov_target", "UsedCOV"]

# ===== 1. 先讀取既有 Seed =====
existing_seeds = set()

if os.path.isfile(fp):
    with open(fp, mode='r', encoding='utf-8') as f:
        reader = csv.DictReader(f)
        for r in reader:
            try:
                existing_seeds.add(int(r["Seed"]))
            except:
                pass

# ===== 2. 判斷是否寫入 =====
if write and seed not in existing_seeds:

    row = {
        "Seed": seed,
        "FARmax": farmax,
        "UsedFAR": usedFAR,
        "cov_target": cov_target,
        "UsedCOV": usedCOV
    }

    file_exists = os.path.isfile(fp)

    with open(fp, mode='a', newline='', encoding='utf-8') as f:
        writer = csv.DictWriter(f, fieldnames=fieldnames)

        if not file_exists:
            writer.writeheader()

        writer.writerow(row)

    a = "written"

else:
    a = "idle"
# ---------- end python_3_script_3 ----------
python_3_script_4 = Python3Script(
    fp=file_path,
    seed=number_slider_2,
    farmax=number_slider,
    usedFAR=ironpython_2_script.UsedFAR,
    cov_target=ironpython_2_script.cov_target,
    usedCOV=ironpython_2_script.UsedCov,
    write=boolean_toggle)  # -> out, a; inputs fp: String, seed: Int32, farmax: Double, usedFAR: Double, cov_target: Double, usedCOV: Double; same code as python_3_script_3

# ----
# OUTPUT!!!
mesh = Mesh(ironpython_2_script.Bldg)

# ----
# 2."True" : save mesh to folder
boolean_toggle_2 = BooleanToggle(False)
file_path_2 = FilePath("C:\Users\harry\Desktop\00Projectz\Computation_Studio\mesh\")
python_3_script_5 = Python3Script(M=mesh, folder=file_path_2, idx=number_slider_2, write=boolean_toggle_2)  # -> flatten(out), a; inputs M: Mesh, idx: Int32, write: Boolean
# ---------- python_3_script_5: Python ----------
import os
import Rhino
import System

ok = False
path = None

if write and M and folder and idx is not None:

    folder_path = str(folder)
    if not os.path.exists(folder_path):
        os.makedirs(folder_path)

    filename = "mesh{0:02d}.stl".format(int(idx))
    path = os.path.join(folder_path, filename)

    # ✅ 匯出前先刪掉舊檔，避免 Rhino 自動產生 .bak
    if os.path.exists(path):
        os.remove(path)
    bak = path + ".bak"
    if os.path.exists(bak):
        os.remove(bak)

    # 1) 把 mesh 暫時加到 Rhino 文件
    mesh = M.DuplicateMesh()
    mesh.Normals.ComputeNormals()
    mesh.Compact()

    doc = Rhino.RhinoDoc.ActiveDoc
    attr = doc.CreateDefaultAttributes()
    obj_id = doc.Objects.AddMesh(mesh, attr)

    if obj_id != System.Guid.Empty:
        # 2) 選取該物件
        doc.Objects.UnselectAll()
        doc.Objects.Select(obj_id)

        # 3) 用 Rhino 的 -_Export 指令匯出 STL
        cmd = '-_Export "{}" _Enter'.format(path)
        ok = Rhino.RhinoApp.RunScript(cmd, False)

        # 4) 刪除暫存物件
        doc.Objects.Delete(obj_id, True)
        doc.Objects.UnselectAll()
# ---------- end python_3_script_5 ----------

panel_4 = Panel(python_3_script_5.out)
